# Grasshopper definition BakuDebug.gh (Grasshopper 1.0.7)
# plug-ins: Heteroptera, Baku, Human

number_slider = Slider(100, range=0..100)
number_slider_2 = Slider(5, range=0..10)
number_slider_3 = Slider(8, range=0..10)
crv = Curve(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)
center = Center(Geometry=crv)  # -> Center, Dimension
scale = Scale(Geometry=crv, Center=center.Center, Factor=Slider(0.2285, range=0..1))  # -> Geometry, Transform
addition = Addition(A=number_slider_2, B=1)
addition_2 = Addition(A=number_slider_2, B=2)
neg = Negative(Value=number_slider)
neg_2 = Negative(Value=number_slider)
divide = DivideCurve(Curve=scale.Geometry, Count=10, Kinks=False)  # -> Points, Tangents, Parameters
lng = ListLength(List=divide.Points)
addition_3 = Addition(A=number_slider_3, B=1)
dom = ConstructDomain(DomainStart=0, DomainEnd=Slider(55, range=0..1000))
dom_2 = ConstructDomain(DomainStart=neg, DomainEnd=number_slider)
dom_3 = ConstructDomain(DomainStart=neg_2, DomainEnd=number_slider)
series = Series(Start=0, Step=1, Count=lng)
multiplication = Multiplication(A=series, B=addition)
multiplication_2 = Multiplication(A=series, B=addition_2)
random = Random(Range=dom_2, Number="3", Seed=number_slider_3)
random_2 = Random(Range=dom, Number=1, Seed=multiplication)  # -> flatten(Random)
random_3 = Random(Range=dom, Number=1, Seed=multiplication_2)  # -> flatten(Random)
random_4 = Random(Range=dom_3, Number="3", Seed=addition_3)
multiplication_3 = Multiplication(A=series, B=number_slider_2)
item = ListItem(List=random, Index=0, Wrap=True)  # -> Item, Item1, Item2
item_2 = ListItem(List=random_4, Index=0, Wrap=True)  # -> Item, Item1, Item2
Z = UnitZ(Factor=random_2)
Z_2 = UnitZ(Factor=random_3)
random_5 = Random(Range=dom, Number=1, Seed=multiplication_3)  # -> flatten(Random)
Z_3 = UnitZ(Factor=random_5)
move = Move(Geometry=divide.Points, Motion=Z_3)  # -> Geometry, Transform
move_2 = Move(Geometry=divide.Points, Motion=Z)  # -> Geometry, Transform
move_3 = Move(Geometry=divide.Points, Motion=Z_2)  # -> Geometry, Transform
vec = VectorXYZ(XComponent=item.Item, YComponent=item.Item1, ZComponent=item.Item2)  # -> Vector, Length
vec_2 = VectorXYZ(XComponent=item_2.Item, YComponent=item_2.Item1, ZComponent=item_2.Item2)  # -> Vector, Length
intcrv = Interpolate(Vertices=move.Geometry, Degree=3, Periodic=False, KnotStyle=1)  # -> Curve, Length, Domain
intcrv_2 = Interpolate(Vertices=move_2.Geometry, Degree=3, Periodic=False, KnotStyle=1)  # -> Curve, Length, Domain
intcrv_3 = Interpolate(Vertices=move_3.Geometry, Degree=3, Periodic=False, KnotStyle=1)  # -> Curve, Length, Domain
move_4 = Move(Geometry=intcrv_2.Curve, Motion=vec.Vector)  # -> Geometry, Transform
move_5 = Move(Geometry=intcrv_3.Curve, Motion=vec_2.Vector)  # -> Geometry, Transform
merge = Merge(Data1=intcrv.Curve, Data2=move_4.Geometry, Data3=move_5.Geometry)

# ---- group: Boundary box
bbox = BoundingBox(Content=merge, Plane=PlaneXY(0, 0, 0), UnionBox=True)  # -> Box, Box_2
center_2 = Center(Geometry=bbox.Box)  # -> Center, Dimension
scale_2 = Scale(Geometry=bbox.Box, Center=center_2.Center, Factor=Slider(1.506, range=0..10))  # -> Geometry, Transform

# ----
lng_2 = ListLength(List=merge)
division = Division(A=Slider(10000, range=0..10000), B=lng_2)
divide_2 = DivideCurve(Curve=merge, Count=division, Kinks=False)  # -> flatten(Points), Tangents, Parameters
cohesion = BoidsCohesion(CohesionRange=Slider(4.006, range=0..10), CohesionWeight=Slider(0.37088, range=0..1))
separation = BoidsSeparation(SeparationRange=Slider(8.0101, range=0..100), SeparationWeight=Slider(2.354, range=0..10))
alignment = BoidsAlignment(AlignmentRange=Slider(9.196, range=0..10), AlignmentWeight=Slider(0.8, range=0..10))
debrep = DeconstructBrep(Brep=scale_2.Geometry)  # -> Faces, Edges, Vertices
list = ValueList({"CPU": 0, "OpenCL": 1, "CUDA": 2}, selected="CUDA")
line = Line(debrep.Edges)
accelerator = AcceleratorContext(DeviceIndex=list)  # -> DevicesInfo, Accelerator
boundary = BoidsBoundary(
    BoundingBox=scale_2.Geometry,
    Range=Slider(73, range=0..100),
    Weight=Slider(0.1, range=0..1),
    Exponent=Slider(3, range=0..10))
agent = ConstructAgent(
    Points=divide_2.Points,
    MaxSpeed=Slider(1.824, range=0..10),
    FieldOfView=Slider(30, range=0..360),
    Separation=separation,
    Cohesion=cohesion,
    Alignment=alignment,
    Boundary=boundary)
panel = Panel(accelerator.DevicesInfo)
panel_2 = Panel(accelerator.Accelerator)
boids = BoidsEngine(
    Accelerator=accelerator.Accelerator,
    Agent=agent,
    Speed=Slider(1, range=0..1),
    Interval=Slider(10, range=0..100),
    Run=Toggle(False),
    Reset=Button())  # -> AgentPoints, Velocity
pt = Point(boids.AgentPoints)
vec_3 = Vector(boids.Velocity)
lng_3 = ListLength(List=pt)
series_2 = Series(Start=0, Step=1, Count=lng_3)
button = Button()  # disabled
bnd = Bounds(Numbers=series_2)
remap = RemapNumbers(Value=series_2, Source=bnd, Target=Domain(0, 1))  # -> Mapped, Clipped
trails = AgentTrails(AgentPositions=pt, Reset=button)  # disabled
amp = Amplitude(Vector=vec_3, Amplitude=Slider(1.67859, range=0..10))
swatch = ColourSwatch(SwatchColor=RGB(255, 255, 255))  # disabled
gradient = Gradient(
    LowerLimit=0,
    UpperLimit=1,
    Parameter=remap.Mapped,
    stops=[0: RGB(234, 38, 0), 0.25: RGB(234, 126, 0), 0.5: RGB(254, 244, 84), 0.75: RGB(173, 203, 249), 1: RGB(75, 107, 169)])
crv_2 = Curve(trails)  # disabled
previewlw = CustomPreviewLineweights(Geometry=crv_2, Shader=swatch, Absolute=False)  # disabled
vdisex = VectorDisplayEx(Point=pt, Vector=amp, Colour=gradient, Width=2)
