# Grasshopper definition BakuExample.gh (Grasshopper 1.0.7)
# plug-ins: Heteroptera, Baku, Human

# ----
# 2. Pre-process inputs
bbox_size = Slider(8.317, range=0..10)
agent_count = Slider(10000, range=0..10000)
# You must supply
# `starting points` and a `Bounding box` for the agent
crv = Curve([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])
bbox = BoundingBox(Content=crv, Plane=PlaneXY(0, 0, 0), UnionBox=True)  # -> Box, Box_2
lng = ListLength(List=crv)
division = Division(A=agent_count, B=lng)
center = Center(Geometry=bbox.Box)  # -> Center, Dimension
divide = DivideCurve(Curve=crv, Count=division, Kinks=False)  # -> flatten(Points), Tangents, Parameters
scale = Scale(Geometry=bbox.Box, Center=center.Center, Factor=bbox_size)  # -> Geometry, Transform

# ----
# 3. Adjust agent force parameters
# Adjusting parameters is tricky,
# you'll have to experiment yourself
# to find the right balance between each forces and ranges
# Separation
# Separation ensures each agent maintains a
# minimum distance from others to avoid crowding.
number_slider = Slider(5.1351, range=0..100)
separation = BoidsSeparation(SeparationRange=number_slider, SeparationWeight=Slider(1.926, range=0..10))

# ----
# Cohesion
# Cohesion guides agents to move towards
# the average position of nearby peers,
# ensures a unified group movement.
number_slider_2 = Slider(9.491, range=0..10)
cohesion = BoidsCohesion(CohesionRange=number_slider_2, CohesionWeight=Slider(0.1702, range=0..1))

# ----
# Alignment
# Alignment adjusts a agent's direction to
# match the average heading of its
# neighbors, ensuring harmonious
# movement within the flock.
# Wikipedia reference
# https://en.wikipedia.org/wiki/Boids
number_slider_3 = Slider(0.7545, range=0..1)
alignment = BoidsAlignment(AlignmentRange=Slider(5.783, range=0..10), AlignmentWeight=number_slider_3)

# ---- group: Create Accelerator
# 1. Create accelerator
# Your computer must either have a GPU
# that supports OpenCL or CUDA.
# Select device using index
# (Using CUDA device is recommended)
number_slider_4 = Slider(2, range=0..10)
accelerator = AcceleratorContext(DeviceIndex=number_slider_4)  # -> DevicesInfo, Accelerator
panel = Panel(accelerator.DevicesInfo)
panel_2 = Panel(accelerator.Accelerator)

# ----
# 4. Define Agent
number_slider_5 = Slider(180, range=0..360)
# [Max Speed] defines the maximum travel
# speed an agent can reach.
# [Fov] defines the field of view agent can
# observe and interact with.
number_slider_6 = Slider(1, range=0..10)
agent = ConstructAgent(
    Points=divide.Points,
    BoundingBox=scale.Geometry,
    MaxSpeed=number_slider_6,
    FieldOfView=number_slider_5,
    Separation=separation,
    Cohesion=cohesion,
    Alignment=alignment)  # -> flatten(Agent)

# ----
# 5. Run simulation engine
number_slider_7 = Slider(20, range=0..100)
reset = Button()
run = BooleanToggle(False)
boids_engine = BoidsEngine(
    Accelerator=accelerator.Accelerator,
    Agent=agent,
    Speed=Slider(1, range=0..1),
    Interval=number_slider_7,
    Run=run,
    Reset=reset)  # -> AgentPoints, Velocity

pt = Point(boids_engine.AgentPoints)
vec = Vector(boids_engine.Velocity)

# ---- group: Color
lng_2 = ListLength(List=pt)
series = Series(Start=0, Step=1, Count=lng_2)
bnd = Bounds(Numbers=series)
remap = RemapNumbers(Value=series, Source=bnd, Target=Domain(0, 1))  # -> Mapped, Clipped
gradient = Gradient(
    LowerLimit=0,
    UpperLimit=1,
    Parameter=remap.Mapped,
    stops=[0: RGB(234, 38, 0), 0.25: RGB(234, 126, 0), 0.5: RGB(254, 244, 84), 0.75: RGB(173, 203, 249), 1: RGB(75, 107, 169)])

# ----
# 6. Post-process / Visualization data
# Trails
# Draws agent's trails.
# This component can be computational intensive
# as this has to compute on CPU.
button = Button()  # disabled
trails = AgentTrails(AgentPositions=pt, Reset=button)  # disabled
crv_2 = Curve(trails)  # disabled
previewlw = CustomPreviewLineweights(Geometry=crv_2, Shader=gradient, Absolute=False)  # disabled

# ---- group: Vector
amp = Amplitude(Vector=vec, Amplitude=Slider(1.67859, range=0..10))
vdisex = VectorDisplayEx(Point=pt, Vector=amp, Colour=gradient, Width=2)
